% Simulink data dictionary abs_dd.sldd

F32 = Simulink.AliasType(BaseType="single", HeaderFile="standard_defs.h")
F64 = Simulink.AliasType(BaseType="double", HeaderFile="standard_defs.h")
FLAG = Simulink.AliasType(BaseType="uint8", HeaderFile="standard_defs.h")
MODE = Simulink.AliasType(BaseType="uint8", HeaderFile="standard_defs.h")
S16 = Simulink.AliasType(BaseType="int16", HeaderFile="standard_defs.h")
S8 = Simulink.AliasType(BaseType="int8", HeaderFile="standard_defs.h")
S32 = Simulink.AliasType(BaseType="int32", HeaderFile="standard_defs.h")
U16 = Simulink.AliasType(BaseType="uint16", HeaderFile="standard_defs.h")
U8 = Simulink.AliasType(BaseType="uint8", HeaderFile="standard_defs.h")
U32 = Simulink.AliasType(BaseType="uint32", HeaderFile="standard_defs.h")
SMODE = Simulink.AliasType(BaseType="int8", HeaderFile="standard_defs.h")
control_signal = Simulink.Signal(StorageClass="ImportedExtern", DataType="int16")
error_signal = Simulink.Signal(StorageClass="Localizable", DataType="int8")
input_voltage = Simulink.Signal(StorageClass="Localizable", DataType="uint16", Min=0, Max=65535)
induced_current = Simulink.Signal(StorageClass="Localizable", DataType="uint32", Min=0, Max=4294967295)
braking_torque = Simulink.Signal(StorageClass="Localizable", DataType="uint16", Min=0, Max=65535)
drag_forces = Simulink.Signal(StorageClass="Localizable", DataType="uint32", Min=0, Max=4294967295)
vehicle_acceleration = Simulink.Signal(StorageClass="Localizable", DataType="uint32", Min=0, Max=4294967295)
angular_velocity_wheel = Simulink.Signal(StorageClass="ExportToFile", HeaderFile="abs_Function.h", DefinitionFile="abs_Function_RAM.c")
angular_acceleration = Simulink.Signal(StorageClass="Localizable")
angular_velocity_vehicle = Simulink.Signal(StorageClass="ExportToFile", HeaderFile="abs_Function.h", DefinitionFile="abs_Function_RAM.c", DataType="uint16", Min=0, Max=65535)
applied_voltage = Simulink.Signal(StorageClass="ImportedExtern", DataType="double")
vehicle_velocity = Simulink.Signal(StorageClass="ExportToFile", HeaderFile="abs_Function.h", DefinitionFile="abs_Function_RAM.c", DataType="double")
slip_ratio = Simulink.Signal(StorageClass="ExportToFile", HeaderFile="abs_Function.h", DefinitionFile="abs_Function_RAM.c", DataType="double")
stopping_distance = Simulink.Signal(StorageClass="ExportToFile", HeaderFile="abs_Function.h", DefinitionFile="abs_Function_RAM.c", DataType="double")
friction_coefficient = Simulink.Signal(StorageClass="ImportedExtern")